# Dynamo graph Add_Revision_In_Sheet.dyn (Dynamo 2.6.1.8786)
# packages: Crumple 2021.9.24, archi-lab.net 2022.212.2821

categories = Categories("OST_Sheets")
all_elements_of_category = ElementsOfCategory(Category=categories)
select_revision = RevitRevisions("Seq. 1 - CONTAINMENT")
boolean = BoolSelector(true)
sheetaddrevisions = Custom[© SheetAddRevisions](sheets=all_elements_of_category, revisions=select_revision, runMe=boolean)  # package Crumple; Given a list of sheets, attempt to add the given revisions to each of those sheets.
remove_revision_from_sheet = Custom[Remove Revision from Sheet]()  # package archi-lab.net; This node will remove specified Revisions from a sheet.; unwired: sheet, revision
